# Grasshopper definition pipeline_questionnaire.gh (Grasshopper 1.0.8)
# plug-ins: Heteroptera, CORE.Grasshopper.Colibri, LunchBox, LadybugGrasshopper

# ----
# 1) Input submission file path and turn the toggle to True
panel = Panel("")
falsestart = LBFalseStartToggle(False)

# ----
# 2) Input the building ploygon file
panel_2 = Panel("")

# ----
# 3) Input the EPW weather file path,
#     make sure the DDY file is in the same folder woth the EPW file
panel_3 = Panel("")

# ----
# 4) Input your simulation year
panel_4 = Panel("")

# ----
# 5) Define your simulation output directory path
panel_5 = Panel("")

# ----
# 6) Set to turn if you only want the simulation inputs for UrabnOPT without running the simulation
falsestart_2 = LBFalseStartToggle(False)

# ----
# 7) Set to turn to run the simulation
falsestart_3 = LBFalseStartToggle(False)

split = TextSplit(Text=panel, Separators="\")
item = ListItem(List=split, Index=-1, Wrap=True)
split_2 = TextSplit(Text=item, Separators=".")
item_2 = ListItem(List=split_2, Index=0, Wrap=True)
excelread = ExcelReader(ReadExcelData=falsestart, WorkbookPath=panel, WorksheetName=item_2)  # -> Exceptions, ExcelData
branch = TreeBranch(Tree=excelread.ExcelData, Path="{0}", MaintainPaths=True)
lng = ListLength(List=branch)
subtraction = Subtraction(A=lng, B=1)
series = Series(Start=1, Step=1, Count=10)
series_2 = Series(Start=1, Step=1, Count=subtraction)
item_3 = ListItem(List=excelread.ExcelData, Index=0, Wrap=True)  # -> flatten(Item)
item_4 = ListItem(List=excelread.ExcelData, Index=series_2, Wrap=True)
panel_6 = Panel(item_3)
bang = ExplodeTree(Data=item_4)  # -> Branch0, Branch1, Branch2, Branch3, Branch4, Branch5, Branch6, Branch7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

panel_7 = Panel("Rent/own")
data = Data(bang.Branch2)

panel_8 = Panel("Address")
data_2 = Data(bang.Branch1)

panel_9 = Panel("Model")
data_3 = Data(bang.Branch9)

panel_10 = Panel("Area")
data_4 = Data(bang.Branch12)

data_5 = Data(bang.Branch5)
panel_11 = Panel("Job")

panel_12 = Panel("Occup. num.")
data_6 = Data(bang.Branch3)

panel_13 = Panel("Worker num.")
data_7 = Data(bang.Branch4)

panel_14 = Panel("Ext wall")
data_8 = Data(bang.Branch16)

panel_15 = Panel("Roof")
data_9 = Data(bang.Branch17)

panel_16 = Panel("Int wall")
data_10 = Data(bang.Branch18)

panel_17 = Panel("Floor")
data_11 = Data(bang.Branch19)

panel_18 = Panel("CSP")
data_12 = Data(bang.Branch21)

panel_19 = Panel("Condition")
data_13 = Data(bang.Branch15)

panel_20 = Panel("HSP")
data_14 = Data(bang.Branch20)

panel_21 = Panel("Fuel")
data_15 = Data(bang.Branch22)

panel_22 = Panel("Heating")
data_16 = Data(bang.Branch23)

panel_23 = Panel("Cooling")
data_17 = Data(bang.Branch24)

panel_24 = Panel("Cars")
data_18 = Data(bang.Branch25)

panel_25 = Panel("EV")
data_19 = Data(bang.Branch26)

panel_26 = Panel("Charging")
data_20 = Data(bang.Branch27)

panel_27 = Panel("Weekend")
data_21 = Data(bang.Branch8)

panel_28 = Panel("WWR")
data_22 = Data(bang.Branch11)

panel_29 = Panel("Attic")
data_23 = Data(bang.Branch14)

panel_30 = Panel("Commute")
data_24 = Data(bang.Branch6)

panel_31 = Panel("Workday")
data_25 = Data(bang.Branch7)

panel_32 = Panel("Stories")
data_26 = Data(bang.Branch13)

split_3 = TextSplit(Text=data_14, Separators=" ")
mindex = MemberIndex(Set=split_3, Member="°C")  # -> flatten(Index), Count
mindex_2 = MemberIndex(Set=split_3, Member="°F")  # -> flatten(Index), Count
subtraction_2 = Subtraction(A=mindex.Index, B=1)
subtraction_3 = Subtraction(A=mindex_2.Index, B=1)
item_5 = ListItem(List=split_3, Index=graft(subtraction_2), Wrap=True)  # -> flatten(Item)
item_6 = ListItem(List=split_3, Index=graft(subtraction_3), Wrap=True)  # -> flatten(Item)
num = Number(item_6)
num_2 = Number(item_5)
subtraction_4 = Subtraction(A=num, B=32)
null = NullItem(Item=num_2)  # -> NullFlags, InvalidFlags, Description
division = Division(A=subtraction_4, B=1.8)
mindex_3 = MemberIndex(Set=null.NullFlags, Member=True)  # -> Index, Count
replace = ReplaceItems(List=num_2, Item=division, Indices=mindex_3.Index, Wrap=False)

split_4 = TextSplit(Text=data_12, Separators=" ")
mindex_4 = MemberIndex(Set=split_4, Member="°C")  # -> flatten(Index), Count
mindex_5 = MemberIndex(Set=split_4, Member="°F")  # -> flatten(Index), Count
subtraction_5 = Subtraction(A=mindex_4.Index, B=1)
subtraction_6 = Subtraction(A=mindex_5.Index, B=1)
item_7 = ListItem(List=split_4, Index=graft(subtraction_5), Wrap=True)  # -> flatten(Item)
item_8 = ListItem(List=split_4, Index=graft(subtraction_6), Wrap=True)  # -> flatten(Item)
num_3 = Number(item_8)
num_4 = Number(item_7)
subtraction_7 = Subtraction(A=num_3, B=32)
null_2 = NullItem(Item=num_4)  # -> NullFlags, InvalidFlags, Description
division_2 = Division(A=subtraction_7, B=1.8)
mindex_6 = MemberIndex(Set=null_2.NullFlags, Member=True)  # -> Index, Count
replace_2 = ReplaceItems(List=num_4, Item=division_2, Indices=mindex_6.Index, Wrap=False)

panel_33 = Panel("""Yes
No""")
mindex_7 = MemberIndex(Set=panel_33, Member=data_23)  # -> flatten(Index), Count
panel_34 = Panel("""0.5
0""")
item_9 = ListItem(List=panel_34, Index=mindex_7.Index, Wrap=True)
addition = Addition(A=data_26, B=item_9)
mindex_8 = MemberIndex(Set=addition, Member=0)  # -> Index, Count
replace_3 = ReplaceItems(List=addition, Item=1, Indices=mindex_8.Index, Wrap=False)

ma = MassAddition(Input=data_6)  # -> Result, PartialResults
ma_2 = MassAddition(Input=data_7)  # -> Result, PartialResults

panel_35 = Panel("""I'm currently not working
I'm working from home
about 15mins
about 30mins
about 45mins
about an hour
about an hour and 15mins
about an hour and 30mins
about an hour and 45mins
about two hours""")
mindex_9 = MemberIndex(Set=panel_35, Member=data_24)  # -> flatten(Index), Count
panel_36 = Panel("""0.0
0.0
0.25
0.5
0.75
1.0
1.25
1.5
1.75
2.0""")
item_10 = ListItem(List=panel_36, Index=mindex_9.Index, Wrap=True)

panel_37 = Panel("""Less than 10%
10 - 20%
20 - 30%
30 - 50%
More than 50%""")
mindex_10 = MemberIndex(Set=panel_37, Member=data_22)  # -> flatten(Index), Count
panel_38 = Panel("""0.1
0.15
0.25
0.4
0.6""")
item_11 = ListItem(List=panel_38, Index=mindex_10.Index, Wrap=True)

ma_3 = MassAddition(Input=data_18)  # -> Result, PartialResults
ma_4 = MassAddition(Input=data_19)  # -> Result, PartialResults
division_3 = Division(A=ma_4.Result, B=ma_3.Result)

split_5 = TextSplit(Text=data_25, Separators=" ")
item_12 = ListItem(List=split_5, Index=9, Wrap=True)  # -> flatten(Item)
item_13 = ListItem(List=split_5, Index=11, Wrap=True)  # -> flatten(Item)

split_6 = TextSplit(Text=data_21, Separators=" ")
item_14 = ListItem(List=split_6, Index=9, Wrap=True)  # -> flatten(Item)
item_15 = ListItem(List=split_6, Index=11, Wrap=True)  # -> flatten(Item)

# ----
# EV Percentage
data_27 = Data(division_3)

# ----
# Heating Fuel
# Heating Type
# AC type
# Building HVAC Data Input
data_28 = Data(data_16)
data_29 = Data(data_17)
data_30 = Data(data_15)
merge = Merge(Data1=simplify(graft(data_30)), Data2=simplify(graft(data_28)), Data3=simplify(graft(data_29)))
join = TextJoin(Text=merge, Join=",")  # -> flatten(Result)
panel_39 = Panel(join)

# ----
# Occupancy Number
data_31 = Data(data_6)

# ----
# Story Number
data_32 = Data(replace_3)

# ----
# 16 Years and Over
data_33 = Data(ma.Result)

# ----
# Worker Number
data_34 = Data(ma_2.Result)

# ----
# Grade
data_35 = Data(data_13)

# ----
# Footprint GeoJSON
path = FilePath(panel_2)

# ----
# Heating Setpoint
data_36 = Data(replace)

# ----
# Cooling Setpoint
data_37 = Data(replace_2)

# ----
# Employ Rate (1-A)
division_4 = Division(A=data_34, B=data_33)
expression = Expression(x=division_4, Expression="Format(\"{0:0.00}\", x)")

# ----
# EXT-W
# Roof
# INT-W
# Floor
# Building Data
data_38 = Data(data_10)
data_39 = Data(data_8)
data_40 = Data(data_11)
data_41 = Data(data_9)

# ----
# Stories
int = Integer(data_32)
lng_2 = ListLength(List=int)
equals = Equality(FirstNumber=int, SecondNumber="0")  # -> Equality, Inequality
series_3 = Series(Start="0", Step=1, Count=lng_2)
dispatch = Dispatch(List=series_3, DispatchPattern=equals.Inequality)  # -> ListA, ListB
dispatch_2 = Dispatch(List=int, DispatchPattern=equals.Inequality)  # -> ListA, ListB
lng_3 = ListLength(List=dispatch_2.ListB)
dup = DuplicateData(Data="1", Number=lng_3, Order=True)
merge_2 = Merge(Data1=dispatch.ListA, Data2=dispatch.ListB)  # -> flatten(Result)
merge_3 = Merge(Data1=dispatch_2.ListA, Data2=dup)  # -> flatten(Result)
sort = SortList(Keys=merge_2, ValuesA=merge_3)  # -> Keys, graft(ValuesA)

# ----
# setpoint from DOE prototype
panel_40 = Panel("Temperature")
constantschedule = HBConstantSchedule(values=graft(data_36), type_limit=panel_40)  # -> report, schedule, idf_text; plug-in component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
constantschedule_2 = HBConstantSchedule(values=graft(data_37), type_limit=panel_40)  # -> report, schedule, idf_text; plug-in component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
setpoint = HBSetpoint(heating_sch=constantschedule.schedule, cooling_sch=constantschedule_2.schedule)  # -> setpoint; plug-in component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

# ----
# no
# (2-r)>1
# yes
# (2-r)<1
# check if they use
# more than one hour
# on transportation
panel_41 = Panel("2")
subtraction_8 = Subtraction(A=panel_41, B=item_10)
larger = LargerThan(FirstNumber=subtraction_8, SecondNumber="1")  # -> LargerThan, OrEqualTo
dispatch_3 = Dispatch(List=subtraction_8, DispatchPattern=larger.OrEqualTo)  # -> ListA, ListB

# ----
# Data Set
roof = Panel("""I'm not sure
Asbestos shingles
Asphalt, fiberglass, or composite shingles
Clay tiles
Concrete tiles
Metal roofing
Rolled composite roofing
Rubber roofing
Slate tiles
Tar and gravel roof
Wood shingles""")
ext_w = Panel("""I'm not sure
Aluminum or vinyl siding
Asphalt or asbestos siding
Brick and stone construction
Brick and stone veneer
Concrete block construction
Stucco finishes
Wood clapboard siding
Wood shingle siding""")
floor = Panel("""I'm not sure
Carpet
Tile flooring
Hardwood flooring
Softwood flooring
Vinyl flooring""")
int_w = Panel("""I'm not sure
Drywall
Gypsum board
Masonry
Plaster
Wood paneling""")

# ----
# HVAC Selection
heating_fuel_set = Panel("""I don't pay for heating and cooling
Gas
Oil
Electricity
Propane""")
heating_set = Panel("""I don’t use heating
Warm air blown through vents (forced air)
Hot water through radiators or pipes (radiant or baseboard heating)
Electric baseboard heaters
Wood stove or fireplace
Steam radiators
Space heaters (portable electric or gas)
Heat pump (electricity powered air conditioner for both heating and cooling)""")
cooling_set = Panel("""I don't use cooling
Central air conditioning (cooling through whole house vents)
Window or wall air conditioners
Portable air conditioner
Fans only (ceiling or portable)
Heat pump (electricity powered air conditioner for both heating and cooling)""")
crossref = CrossReference(ListA=heating_fuel_set, ListB=heating_set, ListC=cooling_set, CrossMode=1)  # -> graft(ListA), graft(ListB), graft(ListC)
merge_4 = Merge(Data1=crossref.ListA, Data2=crossref.ListB, Data3=crossref.ListC)
hvac_selection = Panel("""HeatCool:BoilerBaseboard
HeatCool:BoilerBaseboard
HeatCool:BoilerBaseboard
HeatCool:ElectricBaseboard
HeatCool:BoilerBaseboard
HeatCool:ResidentialFurnace
HeatCool:ResidentialFurnace
HeatCool:ResidentialFurnace
AllAir:Furnace_Electric
HeatCool:ResidentialFurnace
HeatCool:BoilerBaseboard
HeatCool:BoilerBaseboard
HeatCool:BoilerBaseboard
HeatCool:BoilerBaseboard
HeatCool:BoilerBaseboard
HeatCool:ElectricBaseboard
HeatCool:BoilerBaseboard
HeatCool:BoilerBaseboard
HeatCool:ElectricBaseboard
HeatCool:BoilerBaseboard
AllAir:Furnace
AllAir:Furnace
AllAir:Furnace
AllAir:Furnace
AllAir:Furnace
HeatCool:BoilerBaseboard
HeatCool:BoilerBaseboard
HeatCool:BoilerBaseboard
HeatCool:BoilerBaseboard
HeatCool:BoilerBaseboard
HeatCool:ResidentialHPNoCool
HeatCool:ResidentialHPNoCool
HeatCool:ResidentialHPNoCool
HeatCool:ResidentialHPNoCool
HeatCool:ResidentialHPNoCool
HeatCool:ResidentialHPNoCool
HeatCool:ResidentialHPNoCool
HeatCool:ResidentialHPNoCool
HeatCool:ResidentialHPNoCool
HeatCool:ResidentialHPNoCool
HeatCool:ResidentialAC
HeatCool:ResidentialAC
HeatCool:ResidentialAC
HeatCool:ResidentialAC
HeatCool:ResidentialAC
HeatCool:ResidentialAC_ResidentialFurnace
HeatCool:ResidentialAC_ResidentialFurnace
HeatCool:ResidentialAC_ResidentialFurnace
HeatCool:ResidentialAC_ResidentialFurnace
HeatCool:ResidentialAC_ResidentialFurnace
HeatCool:ResidentialAC_BoilerBaseboard
HeatCool:ResidentialAC_BoilerBaseboard
HeatCool:ResidentialAC_BoilerBaseboard
HeatCool:ResidentialAC_BoilerBaseboard
HeatCool:ResidentialAC_BoilerBaseboard
HeatCool:ResidentialAC_ElectricBaseboard
HeatCool:ResidentialAC_BoilerBaseboard
HeatCool:ResidentialAC_BoilerBaseboard
HeatCool:ResidentialAC_ElectricBaseboard
HeatCool:ResidentialAC_BoilerBaseboard
AllAir:Furnace
AllAir:Furnace
AllAir:Furnace
AllAir:Furnace
AllAir:Furnace
HeatCool:ResidentialAC_BoilerBaseboard
HeatCool:ResidentialAC_BoilerBaseboard
HeatCool:ResidentialAC_BoilerBaseboard
HeatCool:ResidentialAC_BoilerBaseboard
HeatCool:ResidentialAC_BoilerBaseboard
HeatCool:ResidentialHP
HeatCool:ResidentialHP
HeatCool:ResidentialHP
HeatCool:ResidentialAC_ASHPBaseboard
HeatCool:ResidentialHP
HeatCool:ResidentialHP
HeatCool:ResidentialHP
HeatCool:ResidentialHP
HeatCool:ResidentialHP
HeatCool:ResidentialHP
HeatCool:WindowAC
HeatCool:WindowAC
HeatCool:WindowAC
HeatCool:WindowAC
HeatCool:WindowAC
HeatCool:WindowAC_Furnace
HeatCool:WindowAC_Furnace
HeatCool:WindowAC_Furnace
HeatCool:WindowAC_Furnace
HeatCool:WindowAC_Furnace
HeatCool:WindowAC_BoilerBaseboard
HeatCool:WindowAC_BoilerBaseboard
HeatCool:WindowAC_BoilerBaseboard
HeatCool:WindowAC_BoilerBaseboard
HeatCool:WindowAC_BoilerBaseboard
HeatCool:ResidentialAC_ElectricBaseboard
HeatCool:ResidentialAC_BoilerBaseboard
HeatCool:ResidentialAC_BoilerBaseboard
HeatCool:WindowAC_ElectricBaseboard
HeatCool:ResidentialAC_BoilerBaseboard
HeatCool:WindowAC_Furnace
HeatCool:WindowAC_Furnace
HeatCool:WindowAC_Furnace
HeatCool:WindowAC_Furnace
HeatCool:WindowAC_Furnace
HeatCool:WindowAC_BoilerBaseboard
HeatCool:WindowAC_BoilerBaseboard
HeatCool:WindowAC_BoilerBaseboard
HeatCool:WindowAC_BoilerBaseboard
HeatCool:WindowAC_BoilerBaseboard
HeatCool:WindowAC_BoilerBaseboard
HeatCool:WindowAC_BoilerBaseboard
HeatCool:WindowAC_BoilerBaseboard
HeatCool:WindowAC_ElectricBaseboard
HeatCool:WindowAC_BoilerBaseboard
HeatCool:ResidentialHP
HeatCool:ResidentialHP
HeatCool:ResidentialHP
HeatCool:WindowAC_ASHPBaseboard
HeatCool:ResidentialHP
HeatCool:ResidentialAC
HeatCool:ResidentialAC
HeatCool:ResidentialAC
HeatCool:ResidentialAC
HeatCool:ResidentialAC
HeatCool:ResidentialAC_ResidentialFurnace
HeatCool:ResidentialAC_ResidentialFurnace
HeatCool:ResidentialAC_ResidentialFurnace
HeatCool:ResidentialAC_ResidentialFurnace
HeatCool:ResidentialAC_ResidentialFurnace
HeatCool:ResidentialAC_DHWBaseboard
HeatCool:ResidentialAC_DHWBaseboard
HeatCool:ResidentialAC_DHWBaseboard
HeatCool:ResidentialAC_DHWBaseboard
HeatCool:ResidentialAC_DHWBaseboard
HeatCool:ResidentialAC_ElectricBaseboard
HeatCool:ResidentialAC_ElectricBaseboard
HeatCool:ResidentialAC_ElectricBaseboard
HeatCool:ResidentialAC_ElectricBaseboard
HeatCool:ResidentialAC_ElectricBaseboard
HeatCool:ResidentialAC_ResidentialFurnace
HeatCool:ResidentialAC_ResidentialFurnace
HeatCool:ResidentialAC_ResidentialFurnace
HeatCool:ResidentialAC_ResidentialFurnace
HeatCool:ResidentialAC_ResidentialFurnace
HeatCool:ResidentialAC_BoilerBaseboard
HeatCool:ResidentialAC_BoilerBaseboard
HeatCool:ResidentialAC_BoilerBaseboard
HeatCool:ResidentialAC_BoilerBaseboard
HeatCool:ResidentialAC_BoilerBaseboard
HeatCool:ResidentialAC_BoilerBaseboard
HeatCool:ResidentialAC_BoilerBaseboard
HeatCool:ResidentialAC_BoilerBaseboard
HeatCool:ResidentialAC_BoilerBaseboard
HeatCool:ResidentialAC_BoilerBaseboard
HeatCool:ResidentialHP
HeatCool:ResidentialHP
HeatCool:ResidentialHP
HeatCool:ResidentialHP
HeatCool:ResidentialHP
HeatCool:FCU_Chiller
HeatCool:FCU_Chiller
HeatCool:FCU_Chiller
HeatCool:FCU_Chiller
HeatCool:FCU_Chiller
HeatCool:FCU_ACChiller_ASHP
HeatCool:FCU_ACChiller_ASHP
HeatCool:FCU_ACChiller_ASHP
HeatCool:FCU_ACChiller_ASHP
HeatCool:FCU_ACChiller_ASHP
HeatCool:FCU_ACChiller_DHW
HeatCool:FCU_ACChiller_DHW
HeatCool:FCU_ACChiller_DHW
HeatCool:FCU_ACChiller_DHW
HeatCool:FCU_ACChiller_DHW
HeatCool:FCU_ACChiller_ElectricBaseboard
HeatCool:FCU_ACChiller_ElectricBaseboard
HeatCool:FCU_ACChiller_ElectricBaseboard
HeatCool:FCU_ACChiller_ElectricBaseboard
HeatCool:FCU_ACChiller_ElectricBaseboard
HeatCool:FCU_ACChiller_Boiler
HeatCool:FCU_ACChiller_Boiler
HeatCool:FCU_ACChiller_Boiler
HeatCool:FCU_ACChiller_Boiler
HeatCool:FCU_ACChiller_Boiler
HeatCool:FCU_ACChiller_Boiler
HeatCool:FCU_ACChiller_Boiler
HeatCool:FCU_ACChiller_Boiler
HeatCool:FCU_ACChiller_Boiler
HeatCool:FCU_ACChiller_Boiler
HeatCool:FCU_Chiller_GasHeaters
HeatCool:FCU_Chiller_GasHeaters
HeatCool:FCU_Chiller_GasHeaters
HeatCool:FCU_Chiller_GasHeaters
HeatCool:FCU_Chiller_GasHeaters
HeatCool:ResidentialHP
HeatCool:ResidentialHP
HeatCool:ResidentialHP
HeatCool:ResidentialHP
HeatCool:ResidentialHP
HeatCool:ResidentialHP
HeatCool:ResidentialHP
HeatCool:ResidentialHP
HeatCool:ResidentialHP
HeatCool:ResidentialHP
HeatCool:ResidentialHP
HeatCool:ResidentialHP
HeatCool:ResidentialHP
HeatCool:ResidentialHP
HeatCool:ResidentialHP
HeatCool:ResidentialHP
HeatCool:ResidentialHP
HeatCool:ResidentialHP
HeatCool:ResidentialHP
HeatCool:ResidentialHP
HeatCool:ResidentialHP
HeatCool:ResidentialHP
HeatCool:ResidentialHP
HeatCool:ResidentialHP
HeatCool:ResidentialHP
HeatCool:ResidentialHP
HeatCool:ResidentialHP
HeatCool:ResidentialHP
HeatCool:ResidentialHP
HeatCool:ResidentialHP
HeatCool:ResidentialHP
HeatCool:ResidentialHP
HeatCool:ResidentialHP
HeatCool:ResidentialHP
HeatCool:ResidentialHP
HeatCool:ResidentialHP
HeatCool:ResidentialHP
HeatCool:ResidentialHP
HeatCool:ResidentialHP
HeatCool:ResidentialHP
HeatCool:ResidentialHP
HeatCool:ResidentialHP
HeatCool:ResidentialHP
HeatCool:ResidentialHP
HeatCool:ResidentialHP""")
join_2 = TextJoin(Text=merge_4, Join=",")  # -> flatten(Result)
panel_42 = Panel(join_2)

# ----
# Construction Selection
roof_2 = Panel("""Generic Roof
Typical Built Up Roof
Typical Built Up Roof
Typical Built Up Roof
Typical Built Up Roof
Typical Insulated Metal Building Roof
Typical IEAD Roof
Typical IEAD Roof
Typical IEAD Roof
Typical Built Up Roof
Typical Built Up Roof""")
floor_2 = Panel("""Generic Interior Floor
Typical Carpeted 4in Slab Floor
Generic Interior Floor
Typical Wood Joist Attic Floor
Typical Wood Joist Attic Floor
Typical Interior Floor""")
int_w_2 = Panel("""Generic Interior Wall
Typical Interior Wall
Typical Unninsulated Interior Wall
Typical Interior Partition
Typical Interior Wall
Typical Interior Wall""")
ext_w_2 = Panel("""Generic Exterior Wall
Typical Insulated Steel Framed Exterior Wall
Generic Exterior Wall
Typical Insulated Exterior Mass Wall
Typical Insulated Exterior Mass Wall
Typical Insulated Exterior Mass Wall
Typical Insulated Exterior Mass Wall
Typical Insulated Wood Framed Exterior Wall
Typical Insulated Steel Framed Exterior Wall""")

# ----
# EX-W
# Roof
# IN-W
# Floor
panel_43 = Panel("5A")
constrsetclimate = HBConstructionSetByClimate(climate_zone=panel_43)  # -> constr_set; plug-in component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
mindex_11 = MemberIndex(Set=ext_w, Member=data_39)  # -> Index, Count
mindex_12 = MemberIndex(Set=roof, Member=data_41)  # -> Index, Count
mindex_13 = MemberIndex(Set=int_w, Member=data_38)  # -> Index, Count
mindex_14 = MemberIndex(Set=floor, Member=data_40)  # -> Index, Count
item_16 = ListItem(List=ext_w_2, Index=mindex_11.Index, Wrap=True)
item_17 = ListItem(List=roof_2, Index=mindex_12.Index, Wrap=True)
item_18 = ListItem(List=int_w_2, Index=mindex_13.Index, Wrap=True)
item_19 = ListItem(List=floor_2, Index=mindex_14.Index, Wrap=True)

# ----
# HVAC Selection
heating_set_2 = Panel("""Null
Typical
Water Fh
Forced Air
Steam
Electric
Heat Pump""")
cooling_set_2 = Panel("""Null
Wall Units
Central
Heat Pump""")
heating_fuel_set_2 = Panel("""Null
Gas
Oil
Electric
Propane""")
crossref_2 = CrossReference(ListA=heating_fuel_set_2, ListB=heating_set_2, ListC=cooling_set_2, CrossMode=1)  # -> graft(ListA), graft(ListB), graft(ListC)
merge_5 = Merge(Data1=crossref_2.ListA, Data2=crossref_2.ListB, Data3=crossref_2.ListC)
hvac_selection_2 = Panel("""Null: 
Null: 
Null: 
Null: 
Null: 
HeatCool:BoilerBaseboard
HeatCool:BoilerBaseboard
HeatCool:BoilerBaseboard
HeatCool:ElectricBaseboard
HeatCool:BoilerBaseboard
HeatCool:BoilerBaseboard
HeatCool:BoilerBaseboard
HeatCool:BoilerBaseboard
HeatCool:BoilerBaseboard
HeatCool:BoilerBaseboard
HeatCool:ResidentialFurnace
HeatCool:ResidentialFurnace
HeatCool:ResidentialFurnace
AllAir:Furnace_Electric
HeatCool:ResidentialFurnace
HeatCool:BoilerBaseboard
HeatCool:BoilerBaseboard
HeatCool:BoilerBaseboard
HeatCool:BoilerBaseboard
HeatCool:BoilerBaseboard
Null: 
Null: 
Null: 
HeatCool:ElectricBaseboard
Null: 
Null: 
Null: 
Null: 
HeatCool:ResidentialHPNoCool
Null: 
HeatCool:WindowAC
HeatCool:WindowAC
HeatCool:WindowAC
HeatCool:WindowAC
HeatCool:WindowAC
HeatCool:WindowAC_BoilerBaseboard
HeatCool:WindowAC_BoilerBaseboard
HeatCool:WindowAC_BoilerBaseboard
HeatCool:WindowAC_ElectricBaseboard
HeatCool:WindowAC_BoilerBaseboard
HeatCool:WindowAC_BoilerBaseboard
HeatCool:WindowAC_BoilerBaseboard
HeatCool:WindowAC_BoilerBaseboard
HeatCool:WindowAC_BoilerBaseboard
HeatCool:WindowAC_BoilerBaseboard
HeatCool:WindowAC_Furnace
HeatCool:WindowAC_Furnace
HeatCool:WindowAC_Furnace
HeatCool:WindowAC_Furnace
HeatCool:WindowAC_Furnace
HeatCool:WindowAC_BoilerBaseboard
HeatCool:WindowAC_BoilerBaseboard
HeatCool:WindowAC_BoilerBaseboard
HeatCool:WindowAC_BoilerBaseboard
HeatCool:WindowAC_BoilerBaseboard
Null: 
Null: 
Null: 
HeatCool:WindowAC_ElectricBaseboard
Null: 
Null: 
Null: 
Null: 
HeatCool:WindowAC_ASHPBaseboard
Null: 
HeatCool:ResidentialAC
HeatCool:ResidentialAC
HeatCool:ResidentialAC
HeatCool:ResidentialAC
HeatCool:ResidentialAC
HeatCool:ResidentialAC_BoilerBaseboard
HeatCool:ResidentialAC_BoilerBaseboard
HeatCool:ResidentialAC_BoilerBaseboard
HeatCool:ResidentialAC_ElectricBaseboard
HeatCool:ResidentialAC_BoilerBaseboard
HeatCool:ResidentialAC_BoilerBaseboard
HeatCool:ResidentialAC_BoilerBaseboard
HeatCool:ResidentialAC_BoilerBaseboard
HeatCool:ResidentialAC_BoilerBaseboard
HeatCool:ResidentialAC_BoilerBaseboard
HeatCool:ResidentialAC_ResidentialFurnace
HeatCool:ResidentialAC_ResidentialFurnace
HeatCool:ResidentialAC_ResidentialFurnace
HeatCool:ResidentialAC_ResidentialFurnace
HeatCool:ResidentialAC_ResidentialFurnace
HeatCool:ResidentialAC_BoilerBaseboard
HeatCool:ResidentialAC_BoilerBaseboard
HeatCool:ResidentialAC_BoilerBaseboard
HeatCool:ResidentialAC_BoilerBaseboard
HeatCool:ResidentialAC_BoilerBaseboard
Null: 
Null: 
Null: 
HeatCool:ResidentialAC_ElectricBaseboard
Null: 
Null: 
Null: 
Null: 
HeatCool:ResidentialAC_ASHPBaseboard
Null: 
HeatCool:ResidentialHP
HeatCool:ResidentialHP
HeatCool:ResidentialHP
HeatCool:WindowAC
HeatCool:ResidentialHP
HeatCool:WindowAC_BoilerBaseboard
HeatCool:WindowAC_BoilerBaseboard
HeatCool:WindowAC_BoilerBaseboard
HeatCool:ResidentialHP
HeatCool:WindowAC_BoilerBaseboard
HeatCool:WindowAC_BoilerBaseboard
HeatCool:WindowAC_BoilerBaseboard
HeatCool:WindowAC_BoilerBaseboard
HeatCool:WindowAC_BoilerBaseboard
HeatCool:WindowAC_BoilerBaseboard
HeatCool:ResidentialAC_ResidentialFurnace
HeatCool:ResidentialAC_ResidentialFurnace
HeatCool:ResidentialAC_ResidentialFurnace
HeatCool:ResidentialAC_ResidentialFurnace
HeatCool:ResidentialAC_ResidentialFurnace
HeatCool:WindowAC_BoilerBaseboard
HeatCool:WindowAC_BoilerBaseboard
HeatCool:WindowAC_BoilerBaseboard
HeatCool:WindowAC_BoilerBaseboard
HeatCool:WindowAC_BoilerBaseboard
Null: 
Null: 
Null: 
HeatCool:ResidentialHP
Null: 
Null: 
Null: 
Null: 
HeatCool:ResidentialHP
Null: """)
join_3 = TextJoin(Text=merge_5, Join=",")  # -> flatten(Result)
panel_44 = Panel(join_3)

# ----
# Leakyness
panel_45 = Panel("""0
Poor
Poor To Fair
Fair
Fair To Avg
Average
Avg To Good
Good
Good To Vg
Very Good
Vg To Exc
Excellent""")
mindex_15 = MemberIndex(Set=panel_45, Member=data_35)  # -> Index, Count
panel_46 = Panel("""0.0003
0.0001
0.00015
0.0002
0.00025
0.0003
0.00035
0.0004
0.00045
0.0005
0.00055
0.0006""")
item_20 = ListItem(List=panel_46, Index=mindex_15.Index, Wrap=True)

# ----
# for index 7 and 18 when (2-r)>1
panel_47 = Panel("1")

# ----
# Construction
interiorsubset = HBInteriorConstructionSubset(interior_wall=item_18)  # -> interior_set; plug-in component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
subfacesubset = HBSubfaceSubset()  # -> subface_set; plug-in component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
exteriorsubset = HBExteriorConstructionSubset(exterior_wall=item_16, exterior_roof=item_17, exposed_floor=item_19)  # -> exterior_set; plug-in component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
groundsubset = HBGroundConstructionSubset()  # -> ground_set; plug-in component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
constructionset = HBConstructionSet(
    base_constr_set=constrsetclimate,
    exterior_subset=exteriorsubset,
    ground_subset=groundsubset,
    interior_subset=interiorsubset,
    subface_subset=subfacesubset)  # -> constr_set; plug-in component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

# ----
# index of households working at home or not
panel_48 = Panel("0")
equals_2 = Equality(FirstNumber=item_10, NotGoingToWork=panel_48)  # -> Equality, Inequality
mindex_16 = MemberIndex(Set=equals_2.Equality, Member=Toggle(True))  # -> Index, Count
mindex_17 = MemberIndex(Set=equals_2.Equality, Member=Toggle(False))  # -> Index, Count

# ----
# index of households working at home or not
panel_49 = Panel("0")
equals_3 = Equality(FirstNumber=item_10, NotGoingToWork=panel_49)  # -> Equality, Inequality
mindex_18 = MemberIndex(Set=equals_3.Equality, Member=Toggle(True))  # -> Index, Count
mindex_19 = MemberIndex(Set=equals_3.Equality, Member=Toggle(False))  # -> Index, Count

panel_50 = Panel("Typical Public")

split_7 = TextSplit(Text=panel, Separators=".")
item_21 = ListItem(List=split_7, Index=0, Wrap=True)
split_8 = TextSplit(Text=item_21, Separators="\")
item_22 = ListItem(List=split_8, Index=-1, Wrap=True)

list = ValueList({"Original Scenario": 0, "Electrified Scenario": 1, "Percentage Electrified": 2}, selected="Original Scenario")
index = Slider(0, range=0..13)
panel_51 = Panel("""0
1
0
1
0
1
0
1
0
1
0
1
0
1""")
item_23 = ListItem(List=panel_51, Index=index, Wrap=True)

# ----
# Current Weather File
panel_52 = Panel("https://energyplus-weather.s3.amazonaws.com/north_and_central_america_wmo_region_4/USA/MA/USA_MA_Worcester.Rgnl.AP.725095_TMY3/USA_MA_Worcester.Rgnl.AP.725095_TMY3.zip")
downloadepw = LBDownloadWeather(weather_URL=panel_52)  # -> epw_file, stat_file, ddy_file; plug-in component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
importloc = LBImportLocation(epw_file=downloadepw.epw_file)  # -> location; plug-in component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

# ----
# Weather File
panel_53 = Panel(panel_3)
# RUN SIMULATION
path_2 = FilePath(panel_53)

panel_54 = Panel("F:\IBPSA\2050_ANL_SSP5_original_95_2050_RNM")  # disabled
panel_55 = Panel("""\0to24
\25to49
\50to74
\75to99
\100to124
\125to149
\150to174
\175to199
\200to209""")  # disabled
lng_4 = ListLength(List=panel_55)  # disabled
dup_2 = DuplicateData(Data=panel_54, Number=lng_4, Order=True)  # -> simplify(graft(Data)); disabled
data_42 = Data(simplify(graft(panel_55)))  # disabled
join_4 = TextJoin(Text=[dup_2, data_42])  # -> flatten(Result); disabled
panel_56 = Panel(join_4)  # disabled

toggle = BooleanToggle(True)
simoutput = HBSimulationOutput(zone_energy_use=toggle, system_energy_use=toggle, gains_and_losses=toggle, comfort_metrics=toggle)  # -> report, sim_output; plug-in component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
customoutput = HBCustomSimulationOutput(base_sim_output=simoutput.sim_output, output_names="Exterior Equipment Electricity Energy")  # -> report, sim_output; plug-in component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
simpar = HBSimulationParameter(output=customoutput.sim_output, timestep="1")  # -> sim_par; plug-in component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

# ----
# EUI
eui = HBEndUseIntensity()  # -> eui, eui_end_use, end_uses, gross_floor; plug-in component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
panel_57 = Panel(eui.eui)
panel_58 = Panel(eui.eui_end_use)
panel_59 = Panel(eui.end_uses)
roomenergyresult = HBReadRoomEnergyResult()  # -> cooling, heating, lighting, electric_equip, gas_equip, process, hot_water, fan_electric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; plug-in component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
panel_60 = Panel("""cooling
heating
lighting
electric_equip
hot_water
pump_electric""")
entwine = Entwine(
    Branch00=flatten(roomenergyresult.cooling),
    Branch01=flatten(roomenergyresult.heating),
    Branch02=flatten(roomenergyresult.lighting),
    Branch03=flatten(roomenergyresult.electric_equip),
    Branch04=flatten(roomenergyresult.fan_electric),
    Branch05=flatten(roomenergyresult.pump_electric),
    FlattenInputs=True)
massarithop = LBMassArithmeticOperation(data=entwine, type=graft(panel_60))  # -> data; plug-in component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
normalize = LBAreaNormalize(data=massarithop, area=eui.gross_floor)  # -> data; plug-in component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
monthlychart = LBMonthlyChart(data=flatten(normalize), stack=Toggle(True))  # -> report, data_mesh, data_lines, col_lines, legend, borders, labels, y_title, title, vis_set; plug-in component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

# ----
# Grid Load
falsestart_4 = LBFalseStartToggle(False)
falsestart_5 = LBFalseStartToggle(False)
newtworkattr = DFNetworkAttributes({"Display Name": "display_name", "Simulation Name (Identifier)": "identifier", "Nominal Voltage": "nominal_voltage", "Phase Count": "phase_count", "Wire Count": "power_line.wire_count", "Wire Phases": "power_line.phases"}, selected="Nominal Voltage")
runrnm = DFRunRNM(run=falsestart_4)  # -> report, network, dss_results; plug-in component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
runopendss = DFRunOpenDSS(run=falsestart_5)  # -> report, buildings, connectors, transformers; plug-in component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
colornetattr = DFColorNetworkAttributes(network=runrnm.network, attribute=newtworkattr)  # -> vis_geo, legend, values, colors; plug-in component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
opendssresult = DFReadOpenDSSResult(dss_csv=runopendss.buildings)  # -> factors, condition; plug-in component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
hourlyplot = LBHourlyPlot(data=opendssresult.factors, x_dim="4")  # -> report, mesh, legend, borders, labels, title, vis_set; plug-in component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

# ----
# CARBON
panel_61 = Panel("Future_Hourly_Electricity_Emissions")
importloc_2 = LBImportLocation()  # -> location; plug-in component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
cei = HBCarbonEmissionIntensity(loc_kgMWh=importloc_2)  # -> cei, cei_end_use, end_uses, gross_floor; plug-in component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
customresult = HBReadCustomResult(output_names=panel_61)  # -> results; plug-in component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
panel_62 = Panel(cei.cei)
massarithop_2 = LBMassArithmeticOperation(data=flatten(customresult))  # -> data; plug-in component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
panel_63 = Panel(cei.cei_end_use)
panel_64 = Panel(cei.end_uses)
legendpar = LBLegendParameters(num_decimals="5")  # -> leg_par; plug-in component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
hourlyplot_2 = LBHourlyPlot(data=massarithop_2, legend_par=legendpar)  # -> report, mesh, legend, borders, labels, title, vis_set; plug-in component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

# ----
# EV Charging
panel_65 = Panel("C:\URBANopt-cli-0.14.0\gems\ruby\2.7.0\gems\openstudio-common-measures-gem-0.9.0\lib\measures\add_ev_load")

toggle_2 = BooleanToggle(True)
fromgeojson = DFModelFromGeoJSON(geojson=path, other_geo=toggle_2, import=toggle_2)  # -> report, model, other_geo, location, point; plug-in component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
vizfloors = DFVisualizeFloors(df_objs=flatten(fromgeojson.model))  # -> geo; plug-in component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
file = ReadFile(File="Z:\simulation\CHANDLER_before_0428\filtered_row.csv", PerLineParse=True)
csv = ReadCSV(CSVString=file, Delimiter=",")  # -> Headers, Values
panel_66 = Panel(csv.Headers)
panel_67 = Panel(csv.Values)
cset = CreateSet(List=panel_67)  # -> Set, Map
lng_5 = ListLength(List=cset.Set)
series_4 = Series(Start=0, Step=1, Count=lng_5)
extremes = MinMax(Number=series_4)  # -> Minimum, Maximum
gradient = Gradient(
    LowerLimit=extremes.Minimum,
    UpperLimit=extremes.Maximum,
    Parameter=cset.Map,
    stops=[0: RGB(243, 57, 0), 0.1: RGB(236, 27, 60), 0.2: RGB(210, 0, 118), 0.3: RGB(103, 0, 120), 0.4: RGB(39, 72, 161), 0.5: RGB(1, 192, 229), 0.6: RGB(18, 178, 90), 0.7: RGB(79, 186, 8), 0.8: RGB(220, 237, 32), 0.9: RGB(247, 159, 20), 1: RGB(243, 57, 0)])
legendpar_2 = LBLegendParameters(seg_count=lng_5, colors=gradient)  # -> leg_par; plug-in component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
legend2d = LBLegend2DParameters(seg_height="2%")  # -> leg_par2d; plug-in component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
createlegend = LBCreateLegend(values=series_4, legend_par=legendpar_2, leg_par2d=legend2d)  # -> mesh, title_obj, label_objs, label_text, colors; plug-in component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
panel_68 = Panel(panel_4)

lng_6 = ListLength(List=vizfloors)
series_5 = Series(Start=0, Step=1, Count=lng_6)

# ----
# Road Network
toggle_3 = BooleanToggle(True)
fromgeojson_2 = DFModelFromGeoJSON(geojson=path, all_to_bldg=toggle_3, import=toggle_3)  # -> report, model, other_geo, location, point; plug-in component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
vizfloors_2 = DFVisualizeFloors(df_objs=flatten(fromgeojson_2.model))  # -> geo; plug-in component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
item_24 = ListItem(List=vizfloors_2, Index=expr("-1", 0), Wrap=True)
geo = Geometry(fromgeojson.other_geo)
substation = DFSubstation(geo=item_24)  # -> substation; plug-in component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
topoly = CurveToPolyline(Curve=geo, ToleranceDistance=0, ToleranceAngle=0)  # -> Polyline, Segments
roads = DFRoadNetwork(substation=substation, road_geo=flatten(topoly.Polyline))  # -> report, network; plug-in component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

# ----
# Replacing HVAC with HP
list_2 = ValueList({"25%": 0.25, "50%": 0.5, "75%": 0.75, "100%": 1}, selected="25%")

# ----
# Occupancy Schedule
panel_69 = Panel("1")
subtraction_9 = Subtraction(A=panel_69, B=expression)
num_5 = Number(subtraction_9)
lng_7 = ListLength(List=subtraction_8)
series_6 = Series(Start="0", Step=1, Count=lng_7)
dispatch_4 = Dispatch(List=series_6, DispatchPattern=larger.OrEqualTo)  # -> ListA, ListB
merge_6 = Merge(Data1=dispatch_4.ListA, Data2=dispatch_4.ListB)
lng_8 = ListLength(List=dispatch_3.ListB)
lng_9 = ListLength(List=dispatch_3.ListA)
dup_3 = DuplicateData(Data=panel_47, Number=lng_9, Order=True)
panel_70 = Panel("Occupancy Schedule")
genes = GenePool(Decimals=2, Maximum=1, Minimum=0, Value=[1, 1, 1, 1, 1, 1, 1, 1, 1, 1, 1, 1, 1, 1, 1, 1, 1, 1, 1, 1, 1, 1, 1, 1])

# ----
# for index 8 and 17 when (2-r)>1
index_2 = ItemIndex(List=subtraction_8, Item=dispatch_3.ListA)
item_25 = ListItem(List=item_10, Index=index_2, Wrap=True)
eval = Evaluate(F="1-(1-A)*r", r=item_25, A=num_5)

# ----
# for index 7 and 18 when (2-r)<1
index_3 = ItemIndex(List=subtraction_8, Item=dispatch_3.ListB)
item_26 = ListItem(List=item_10, Index=index_3, Wrap=True)
eval_2 = Evaluate(F="1-(1-A)*(r-1)", r=item_26, A=num_5)
clean = CleanTree(RemoveNulls=True, RemoveInvalid=True, RemoveEmpty=False, Tree=eval_2)

# ----
# for index 8 and 17 when (2-r)<1
panel_71 = Panel(num_5)

# ----
# Default Occupancy Schedule
subtraction_10 = Subtraction(A=item_12, B=1)
subtraction_11 = Subtraction(A=item_13, B=subtraction_10)
num_6 = Number(num_5)
dup_4 = DuplicateData(Data="1", Number="24", Order=True)
series_7 = Series(Start=item_12, Step=1, Count=subtraction_11)
replace_4 = ReplaceItems(List=dup_4, Item=num_6, Indices=series_7, Wrap=False)

# ----
# Occupancy Schedule Weedend
subtraction_12 = Subtraction(A=item_14, B=1)
subtraction_13 = Subtraction(A=item_15, B=subtraction_12)
num_7 = Number(num_5)
dup_5 = DuplicateData(Data=num_7, Number="24", Order=True)
series_8 = Series(Start=item_14, Step=1, Count=subtraction_13)
replace_5 = ReplaceItems(List=dup_5, Item="1", Indices=series_8, Wrap=False)

# ----
# Footprint to Building
series_9 = Series(Start=0, Step=1, Count=10)
item_27 = ListItem(List=vizfloors, Index=series_5, Wrap=True)
lng_10 = ListLength(List=item_27)
dup_6 = DuplicateData(Data="3", Number=sort.ValuesA, Order=True)
series_10 = Series(Start=0, Step=1, Count=lng_10)  # -> graft(Series)

lng_11 = ListLength(List=item_27)
multiplication = Multiplication(A=lng_11, B=list_2)
random = Random(Range=lng_11, Number=multiplication, Seed=2)
replace_6 = ReplaceItems(List=panel_39, Item="Electric,Electric,Heat Pump", Indices=random, Wrap=False)

# ----
# Charging Behavior
list_3 = ValueList({"non-WFH charging behavior": "Business as usual", "WFH charging behavior": "Free Workplace Charging at Project Site", "charge mostly at work": "Free Workplace Charging Across Metro Area"}, selected="WFH charging behavior")
list_4 = ValueList({"non-WFH charging behavior": "Business as usual", "WFH charging behavior": "Free Workplace Charging at Project Site", "charge mostly at work": "Free Workplace Charging Across Metro Area"}, selected="non-WFH charging behavior")
lng_12 = ListLength(List=item_27)
series_11 = Series(Start=0, Step=1, Count=lng_12)
replace_7 = ReplaceItems(List=series_11, Item=list_3, Indices=mindex_16.Index, Wrap=False)
replace_8 = ReplaceItems(List=replace_7, Item=list_4, Indices=mindex_17.Index, Wrap=False)

# ----
# Charging Station type
lng_13 = ListLength(List=item_27)
series_12 = Series(Start=0, Step=1, Count=lng_13)
replace_9 = ReplaceItems(List=series_12, Item="Typical Home", Indices=mindex_18.Index, Wrap=False)
replace_10 = ReplaceItems(List=replace_9, Item="Typical Work", Indices=mindex_19.Index, Wrap=False)

add_ev_load = Add_EV_Load(measure_path=panel_65, charge_behavior=replace_8, chg_station_type=replace_10, ev_percent=data_27)  # -> report, flatten(mapper); plug-in component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

preview = CustomPreview(Geometry=item_27, Material=gradient)

# ----
# Program
bldgprograms = HBBuildingPrograms({"LargeOffice", "MediumOffice", "SmallOffice", "MidriseApartment", "HighriseApartment", "Retail", "StripMall", "PrimarySchool", "SecondarySchool", "SmallHotel", "LargeHotel", "Hospital", "Outpatient", "Laboratory", "Warehouse", "SuperMarket", "FullServiceRestaurant", "QuickServiceRestaurant", "Courthouse", "College", "LargeDataCenterHighITE", "LargeDataCenterLowITE", "SmallDataCenterHighITE", "SmallDataCenterLowITE"}, selected="MidriseApartment")
searchprog = HBSearchPrograms(bldg_prog=bldgprograms, keywords="Apartment")  # -> room_prog; plug-in component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
area = Area(Geometry=item_27)  # -> Area, Centroid
division_5 = Division(A=graft(data_31), B=graft(area.Area))
infiltration = HBInfiltration(flow_per_ext_area=item_20)  # -> infil; plug-in component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

dup_7 = DuplicateData(Data=panel_71, Number=lng_8, Order=True)
entwine_2 = Entwine(Branch00=dup_3, Branch01=clean, FlattenInputs=True)  # -> flatten(Result)
entwine_3 = Entwine(Branch00=eval, Branch01=dup_7, FlattenInputs=True)  # -> flatten(Result)
entwine_4 = Entwine(Branch00=eval, Branch01=dup_7, FlattenInputs=True)  # -> flatten(Result)
entwine_5 = Entwine(Branch00=dup_3, Branch01=clean, FlattenInputs=True)  # -> flatten(Result)
lng_14 = ListLength(List=item_27)
series_13 = Series(Start=0, Step=1, Count=lng_14)  # -> graft(Series)

# ----
# list for index 8
sort_2 = SortList(Keys=merge_6, ValuesA=entwine_3)  # -> Keys, ValuesA

# ----
# list for index 17
sort_3 = SortList(Keys=merge_6, ValuesA=entwine_4)  # -> Keys, ValuesA

# ----
# list for index 18
sort_4 = SortList(Keys=merge_6, ValuesA=entwine_5)  # -> Keys, ValuesA

# ----
# list for index 7
sort_5 = SortList(Keys=merge_6, ValuesA=entwine_2)  # -> Keys, ValuesA

# ----
# HVAC Selecting/Aligning
cset_2 = CreateSet(List=panel_42)  # -> Set, Map
mindex_20 = MemberIndex(Set=cset_2.Set, Member=panel_39)  # -> flatten(Index), Count
panel_72 = Panel("""AllAir
HeatCool
DOAS
Null""")
item_28 = ListItem(List=hvac_selection, Index=mindex_20.Index, Wrap=True)
hvac_selected = Panel(item_28)
split_9 = TextSplit(Text=item_28, Separators=":")
item_29 = ListItem(List=split_9, Index=0, Wrap=True)  # -> flatten(Item)
mindex_21 = MemberIndex(Set=item_29, Member=panel_72)  # -> simplify(Index), Count
item_30 = ListItem(List=split_9, Index="1", Wrap=True)  # -> flatten(Item)
bang_2 = ExplodeTree(Data=mindex_21.Index)  # -> Branch0, Branch1, Branch2, Branch3
item_31 = ListItem(List=item_30, Index=[bang_2.Branch0, bang_2.Branch1, bang_2.Branch2, bang_2.Branch3], Wrap=True)
bang_3 = ExplodeTree(Data=item_31)  # -> Branch0, Branch1, Branch2, Branch3

# ----
# HVAC Selecting/Aligning
cset_3 = CreateSet(List=panel_44)  # -> Set, Map
mindex_22 = MemberIndex(Set=cset_3.Set, Member=replace_6)  # -> flatten(Index), Count
panel_73 = Panel("""AllAir
HeatCool
DOAS
Null""")
item_32 = ListItem(List=hvac_selection_2, Index=mindex_22.Index, Wrap=True)
split_10 = TextSplit(Text=item_32, Separators=":")
hvac_selected_2 = Panel(item_32)
item_33 = ListItem(List=split_10, Index=0, Wrap=True)  # -> flatten(Item)
item_34 = ListItem(List=split_10, Index="1", Wrap=True)  # -> flatten(Item)
mindex_23 = MemberIndex(Set=item_33, Member=panel_73)  # -> simplify(Index), Count
bang_4 = ExplodeTree(Data=mindex_23.Index)  # -> Branch0, Branch1, Branch2, Branch3
item_35 = ListItem(List=item_34, Index=[bang_4.Branch0, bang_4.Branch1, bang_4.Branch2, bang_4.Branch3], Wrap=True)
bang_5 = ExplodeTree(Data=item_35)  # -> Branch0, Branch1, Branch2, Branch3

lng_15 = ListLength(List=sort_5.ValuesA)
lng_16 = ListLength(List=sort_2.ValuesA)
lng_17 = ListLength(List=sort_3.ValuesA)
lng_18 = ListLength(List=sort_4.ValuesA)
series_14 = Series(Start=0, Step=1, Count=lng_15)
series_15 = Series(Start=0, Step=1, Count=lng_16)
series_16 = Series(Start=0, Step=1, Count=lng_17)
series_17 = Series(Start=0, Step=1, Count=lng_18)
item_36 = ListItem(List=sort_5.ValuesA, Index=series_14, Wrap=True)  # -> simplify(graft(Item))
item_37 = ListItem(List=sort_2.ValuesA, Index=series_15, Wrap=True)  # -> simplify(graft(Item))
item_38 = ListItem(List=sort_3.ValuesA, Index=series_16, Wrap=True)  # -> simplify(graft(Item))
item_39 = ListItem(List=sort_4.ValuesA, Index=series_17, Wrap=True)  # -> simplify(graft(Item))

# ----
# replacing the affected hours
# in the default schedule
merge_7 = Merge(Data1=item_36, Data2=item_37, Data3=item_38, Data4=item_39)
panel_74 = Panel("""7
8
17
18""")
replace_11 = ReplaceItems(List=replace_4, Item=merge_7, Indices=panel_74, Wrap=False)

weeklyschedule = HBWeeklySchedule(
    sun=replace_5,
    mon=replace_11,
    tue=replace_11,
    wed=replace_11,
    thu=replace_11,
    fri=replace_11,
    sat=replace_5,
    holiday=genes,
    name=series_13)  # -> report, simplify(schedule), idf_year, idf_week, idf_days; plug-in component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
path_mapper = PathMapper(weeklyschedule.schedule, source="{A}", target="{0;A}")

people = HBPeople(ppl_per_area=division_5, occupancy_sch=path_mapper)  # -> people; plug-in component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
programtype = HBProgramType(base_program=searchprog, people=people, infiltration=infiltration, setpoint=setpoint)  # -> program; plug-in component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

buildingfootprint = DFBuildingFromFootprint(
    footprint_geo=simplify(graft(item_27)),
    floor_to_floor=simplify(dup_6),
    name=series_10,
    program=programtype,
    constr_set=constructionset,
    run=Toggle(True))  # -> report, buildings; plug-in component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
topbottom = DFSeparateTopBottom(buildings=buildingfootprint.buildings)  # -> simplify(buildings); plug-in component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

# ----
# Visualization
number_slider = Slider(0, range=0..10)
path_3 = ConstructPath(Indices=number_slider)
branch_2 = TreeBranch(Tree=weeklyschedule.schedule, Path=path_3, MaintainPaths=True)
schtodata = HBScheduleToData(schedule=branch_2)  # -> data; plug-in component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
hourlyplot_3 = LBHourlyPlot(data=schtodata)  # -> report, mesh, legend, borders, labels, title, vis_set; plug-in component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

# ----
# Assign Window
simpleratiopar = DFSimpleWindowRatioParameters(ratio=item_11)  # -> simplify(win_par); plug-in component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
applyfacadepar = DFApplyFacadeParameters(df_obj=topbottom, win_par=simpleratiopar)  # -> report, df_obj; plug-in component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

item_40 = ListItem(List=flatten(applyfacadepar.df_obj), Index=mindex_21.Index, Wrap=True)
bang_6 = ExplodeTree(Data=item_40)  # -> Branch0, Branch1, Branch2, Branch3
dfdoashvac = DFDOASHVAC(df_objs=simplify(graft(bang_6.Branch2)), system_type=simplify(graft(bang_3.Branch2)))  # -> report, df_objs; plug-in component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
dfallairhvac = DFAllAirHVAC(df_objs=simplify(graft(bang_6.Branch0)), system_type=simplify(graft(bang_3.Branch0)))  # -> report, df_objs; plug-in component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
dfheatcoolhvac = DFHeatCoolHVAC(df_objs=simplify(graft(bang_6.Branch1)), system_type=simplify(graft(bang_3.Branch1)))  # -> report, df_objs; plug-in component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

item_41 = ListItem(List=flatten(applyfacadepar.df_obj), Index=mindex_23.Index, Wrap=True)
bang_7 = ExplodeTree(Data=item_41)  # -> Branch0, Branch1, Branch2, Branch3
dfdoashvac_2 = DFDOASHVAC(df_objs=simplify(graft(bang_7.Branch2)), system_type=simplify(graft(bang_5.Branch2)))  # -> report, df_objs; plug-in component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
dfallairhvac_2 = DFAllAirHVAC(df_objs=simplify(graft(bang_7.Branch0)), system_type=simplify(graft(bang_5.Branch0)))  # -> report, df_objs; plug-in component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
dfheatcoolhvac_2 = DFHeatCoolHVAC(df_objs=simplify(graft(bang_7.Branch1)), system_type=simplify(graft(bang_5.Branch1)))  # -> report, df_objs; plug-in component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

# ----
# All HP Aligned
heatcool = HBHeatCoolHVACTemplates({"Baseboard electric": "ElectricBaseboard", "Baseboard gas boiler": "BoilerBaseboard", "Baseboard central air source heat pump": "ASHPBaseboard", "Baseboard district hot water": "DHWBaseboard", "Direct evap coolers with baseboard electric": "EvapCoolers_ElectricBaseboard", "Direct evap coolers with baseboard gas boiler": "EvapCoolers_BoilerBaseboard"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}, selected="Residential heat pump": "ResidentialHP")
dfheatcoolhvac_3 = DFHeatCoolHVAC(df_objs=simplify(graft(applyfacadepar.df_obj)), system_type=simplify(graft(heatcool)))  # -> report, flatten(df_objs); plug-in component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

# ----
# Percentage HP Aligned
heatcool_2 = HBHeatCoolHVACTemplates({"Baseboard electric": "ElectricBaseboard", "Baseboard gas boiler": "BoilerBaseboard", "Baseboard central air source heat pump": "ASHPBaseboard", "Baseboard district hot water": "DHWBaseboard", "Direct evap coolers with baseboard electric": "EvapCoolers_ElectricBaseboard", "Direct evap coolers with baseboard gas boiler": "EvapCoolers_BoilerBaseboard"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}, selected="Residential heat pump": "ResidentialHP")
entwine_6 = Entwine(
    Branch00=flatten(bang_4.Branch0),
    Branch01=flatten(bang_4.Branch1),
    Branch02=flatten(bang_4.Branch2),
    Branch03=flatten(bang_4.Branch3),
    FlattenInputs=True)  # -> flatten(Result)
panel_75 = Panel(bang_5.Branch1)
entwine_7 = Entwine(
    Branch00=flatten(dfallairhvac_2.df_objs),
    Branch01=flatten(dfheatcoolhvac_2.df_objs),
    Branch02=flatten(dfdoashvac_2.df_objs),
    Branch03=flatten(bang_7.Branch3),
    FlattenInputs=True)  # -> flatten(Result)
toggle_4 = BooleanToggle(False)
dfheatcoolhvac_4 = DFHeatCoolHVAC(df_objs=simplify(graft(applyfacadepar.df_obj)), system_type=simplify(graft(heatcool_2)))  # -> report, flatten(df_objs); plug-in component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
clean_2 = CleanTree(RemoveNulls=True, RemoveInvalid=toggle_4, RemoveEmpty=toggle_4, Tree=entwine_7)
sort_6 = SortList(Keys=entwine_6, ValuesA=clean_2)  # -> Keys, ValuesA

# ----
# HVAC Aligning
entwine_8 = Entwine(
    Branch00=flatten(bang_2.Branch0),
    Branch01=flatten(bang_2.Branch1),
    Branch02=flatten(bang_2.Branch2),
    Branch03=flatten(bang_2.Branch3),
    FlattenInputs=True)  # -> flatten(Result)
panel_76 = Panel(bang_3.Branch1)
entwine_9 = Entwine(
    Branch00=flatten(dfallairhvac.df_objs),
    Branch01=flatten(dfheatcoolhvac.df_objs),
    Branch02=flatten(dfdoashvac.df_objs),
    Branch03=flatten(bang_6.Branch3),
    FlattenInputs=True)  # -> flatten(Result)
toggle_5 = BooleanToggle(False)
clean_3 = CleanTree(RemoveNulls=True, RemoveInvalid=toggle_5, RemoveEmpty=toggle_5, Tree=entwine_9)
sort_7 = SortList(Keys=entwine_8, ValuesA=clean_3)  # -> Keys, ValuesA

# ----
# MODELING
panel_77 = Panel(weeklyschedule.schedule)

# ----
# SCENARIO
# SELECTING
entwine_10 = Entwine(Branch00=sort_7.ValuesA, Branch01=dfheatcoolhvac_3.df_objs, Branch02=sort_6.ValuesA, FlattenInputs=True)
panel_78 = Panel("""{0;0}
{0;1}""")
item_42 = ListItem(List=panel_78, Index=item_23, Wrap=True)
branch_3 = TreeBranch(Tree=entwine_10, Path=item_42, MaintainPaths=True)

model = DFModel(buildings=flatten(branch_3), name=item_22)  # -> report, model; plug-in component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
vizall = DFVisualizeAll(df_objs=flatten(model.model))  # -> geo; plug-in component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

# ----
# separate simulation if needed
lng_19 = ListLength(List=item_27)  # disabled
path_4 = Slider(8, range=0..8)  # disabled
series_18 = Series(Start=0, Step=1, Count=lng_19)  # disabled
panel_79 = Panel("25")  # disabled
partition = PartitionList(List=series_18, Size=panel_79)  # -> simplify(Chunks); disabled
branch_4 = TreeBranch(Tree=partition, Path=path_4, MaintainPaths=True)  # disabled
item_43 = ListItem(List=branch_3, Index=branch_4, Wrap=True)  # disabled
panel_80 = Panel("7313")  # disabled
model_2 = DFModel(buildings=flatten(item_43), name=panel_80)  # -> report, model; disabled; plug-in component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
item_44 = ListItem(List=panel_56, Index=path_4, Wrap=True)  # disabled
path_5 = FilePath(item_44)  # disabled

# ----
# Create Scenario
# file and URBANopt
# folder Generation
panel_81 = Panel("10")
togeojson = DFModelToGeoJSON(model=model.model, location=importloc, shade_dist=panel_81, network=roads.network, folder=panel_5, write=falsestart_3)  # -> report, geojson, net_json, hb_jsons, hb_models; plug-in component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
dispatch_5 = Dispatch(List=falsestart_2, DispatchPattern=[True, False])  # -> ListA, ListB
runurbanopt = DFRunURBANopt(
    geojson=togeojson.geojson,
    epw_file=path_2,
    sim_par=simpar,
    mappers=add_ev_load.mapper,
    emiss_yr=panel_68,
    run=dispatch_5.ListA)  # -> out, scenario, osm, idf, sql, zsz, rdd, html; plug-in component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
runurbanopt_2 = DFRunURBANopt(
    geojson=togeojson.geojson,
    epw_file=path_2,
    sim_par=simpar,
    mappers=add_ev_load.mapper,
    emiss_yr=panel_68,
    run=dispatch_5.ListB)  # -> out, scenario, osm, idf, sql, zsz, rdd, html; plug-in component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

path02 = FilePath(runurbanopt_2.scenario)

path01 = FilePath(togeojson.geojson)
colibri_out = ColibriOutputs(Path01=flatten(path01), Path02=flatten(path02))
colibri_in = ColibriInputsIterator(Index=index, ignoreAllWarningMsg=True)  # -> U, IP, Index, V_N
ca = ColibriAggregator(Folder="c:\Colibri", Inputs=colibri_in.IP, Outputs=colibri_out, Write=Toggle(False), recordingMode=0)
